% Simulink data dictionary SIMenvGlobl.sldd

SIMenvConfigRef = Simulink.ConfigSet(StartTime="0", StopTime="10", RelTol="1e-3", Solver="VariableStepAuto", ProdHWDeviceType="Intel->x86-64 (Windows64)", SystemTargetFile="grt.tlc", TargetLang="C")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
SmplTSim_T = Simulink.Parameter(0.001, DataType="double")  % Cal